# Grasshopper definition dds_python_components_basic.gh (Grasshopper 1.0.8)

xy = XYPlane(Origin="50,40,10")
dds_target_from_plane = Python3Script(Plane=xy)  # -> out, Target; inputs Plane: Plane
# ---------- dds_target_from_plane: Python ----------
# DDS Target From Plane
# Inputs: Plane
# Outputs: Target
from dds.gh_helpers.components import make_target_from_plane

Target = None

try:
    Target = make_target_from_plane(Plane)
    print("Target:", Target.position.to_tuple(), Target.normal.to_tuple())
except Exception as exc:
    print("Target from plane failed:", repr(exc))
# ---------- end dds_target_from_plane ----------

crv = Curve(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)
pframes = PerpFrames(Curve=crv, Count=Slider(20, range=0..100), Align=True)  # -> Frames, Parameters
deplane = DeconstructPlane(Plane=pframes.Frames)  # -> Origin, XAxis, YAxis, ZAxis
pl = ConstructPlane(Origin=deplane.Origin, XAxis=deplane.ZAxis, YAxis=deplane.XAxis)
dds_target_from_plane_2 = Python3Script(Plane=pl)  # -> out, Target; inputs Plane: Plane; same code as dds_target_from_plane

box = DomainBox(Base=PlaneXY(0, 0, 0), X="0 To 100", Y="0 To 100", Z="0 To 100")

dds_setup = Python3Script(run=Button(), package_path="/Users/ozgucbertugcapunaman/Documents/GitHub/3DP-DDS/src")  # -> out, DDSPath; inputs run: Boolean, package_path: String
# ---------- dds_setup: Python ----------
# DDS Setup
# Inputs: package_path, run
# Outputs: OK, DDSPath
import sys
import scriptcontext as sc

KEY = "dds.gh_helpers.source_path"

if run and package_path:
    sc.sticky[KEY] = package_path

DDS_SRC = sc.sticky.get(KEY, package_path)

if DDS_SRC and DDS_SRC not in sys.path:
    sys.path.insert(0, DDS_SRC)

OK = False
DDSPath = None

if DDS_SRC:
    try:
        import dds
        import dds.gh_helpers

        DDSPath = dds.__file__
        OK = bool(DDSPath and DDSPath.startswith(DDS_SRC))
        if OK:
            print("DDS loaded from:", DDSPath)
        else:
            print("DDS imported from unexpected path:", DDSPath)
    except Exception as exc:
        OK = False
        DDSPath = None
        print("DDS setup failed:", repr(exc))
else:
    print("Press run with package_path set to the DDS src folder.")
# ---------- end dds_setup ----------

dds_domain = Python3Script(Box=box, voxel_size=Slider(0.5, range=0.1..2))  # -> out, Domain; inputs Box: Box
# ---------- dds_domain: Python ----------
# DDS Domain Box
# Inputs: Box, voxel_size
# Outputs: Domain, PreviewBox
from dds.gh_helpers.components import make_domain_from_box

Domain = None
PreviewBox = None

try:
    Domain, PreviewBox = make_domain_from_box(Box, voxel_size)
    print("Domain:", Domain.grid_shape, "voxels")
except Exception as exc:
    print("Domain creation failed:", repr(exc))
# ---------- end dds_domain ----------

dds_profile = Python3Script(width=Slider(8, range=0..100), height=Slider(6, range=0..10))  # -> out, Profile; inputs width: Double, height: Double
# ---------- dds_profile: Python ----------
# DDS Profile
# Inputs: width, height
# Outputs: Profile
from dds.gh_helpers.components import make_bead_profile

Profile = None

try:
    Profile = make_bead_profile(width, height)
    print("Profile:", Profile.width, "x", Profile.height)
except Exception as exc:
    print("Profile creation failed:", repr(exc))
# ---------- end dds_profile ----------

dds_compose_target = Python3Script(Position="10,20,30", Normal="0,1,0")  # -> out, Target; inputs Position: Point3d, Normal: Vector3d
# ---------- dds_compose_target: Python ----------
# DDS Target
# Inputs: Position, Normal
# Outputs: Target
from dds.gh_helpers.components import make_target

Target = None

try:
    Target = make_target(Position, normal=Normal)
    print("Target:", Target.position.to_tuple(), Target.normal.to_tuple())
except Exception as exc:
    print("Target creation failed:", repr(exc))
# ---------- end dds_compose_target ----------

dds_polyline_deposit = Python3Script(Targets=dds_target_from_plane_2.Target, Profile=dds_profile.Profile, sweep_resolution=".5")  # -> out, Deposit; inputs Targets: list
# ---------- dds_polyline_deposit: Python ----------
# DDS Polyline Deposit
# Inputs: Targets, Profile, sweep_resolution
# Outputs: Deposit
from dds.gh_helpers.components import make_polyline_deposit

Deposit = None

try:
    Deposit = make_polyline_deposit(
        Targets,
        Profile,
        sweep_resolution=sweep_resolution or None,
    )
    print("PolylineDeposit targets:", len(Deposit.targets))
except Exception as exc:
    print("Polyline deposit failed:", repr(exc))
# ---------- end dds_polyline_deposit ----------
dds_point_deposit = Python3Script(Target=dds_compose_target.Target, Profile=dds_profile.Profile)  # -> out, Deposit
# ---------- dds_point_deposit: Python ----------
# DDS Point Deposit
# Inputs: Target, Profile
# Outputs: Deposit
from dds.gh_helpers.components import make_point_deposit

Deposit = None

try:
    Deposit = make_point_deposit(Target, Profile)
    print("PointDeposit created")
except Exception as exc:
    print("Point deposit failed:", repr(exc))
# ---------- end dds_point_deposit ----------
xy_2 = XYPlane(Origin="50,60,70")

dds_target_from_plane_3 = Python3Script(Plane=xy_2)  # -> out, Target; inputs Plane: Plane; same code as dds_target_from_plane

dds_line_deposit = Python3Script(
    StartTarget=dds_target_from_plane_3.Target,
    EndTarget=dds_target_from_plane.Target,
    Profile=dds_profile.Profile,
    sweep_resolution=".5")  # -> out, Deposit
# ---------- dds_line_deposit: Python ----------
# DDS Line Deposit
# Inputs: StartTarget, EndTarget, Profile, sweep_resolution
# Outputs: Deposit
from dds.gh_helpers.components import make_line_deposit

Deposit = None

try:
    Deposit = make_line_deposit(
        StartTarget,
        EndTarget,
        Profile,
        sweep_resolution=sweep_resolution or None,
    )
    print("LineDeposit length:", Deposit.line.length)
except Exception as exc:
    print("Line deposit failed:", repr(exc))
# ---------- end dds_line_deposit ----------
merge = Merge(Data1=dds_point_deposit.Deposit, Data2=dds_line_deposit.Deposit, Data3=dds_polyline_deposit.Deposit)
dds_simulate = Python3Script(Domain=dds_domain.Domain, Deposits=merge, run=Toggle(False), reset=Button())  # -> out, Result; inputs Deposits: list
# ---------- dds_simulate: Python ----------
# DDS Simulate
# Inputs: Domain, Deposits, run, reset, include_coverage, threshold
# Outputs: Result
from dds.gh_helpers.components import run_simulation

Result = None

try:
    Result = run_simulation(
        Domain,
        Deposits,
        run=run,
        reset=reset,
        threshold=0.5,
    )
    if Result is None:
        print("Simulation ready. Set run=True to compute.")
    else:
        print("Simulation deposits:", len(Result.deposits))
except Exception as exc:
    print("Simulation failed:", repr(exc))
# ---------- end dds_simulate ----------
dds_mesh = Python3Script(Result=dds_simulate.Result)  # -> out, Mesh
# ---------- dds_mesh: Python ----------
# DDS Mesh
# Inputs: Result, threshold, step_size
# Outputs: Mesh
from dds.gh_helpers.components import make_mesh

Mesh = None

try:
    if Result is None:
        print("No Result input.")
    else:
        Mesh = make_mesh(
            Result,
            threshold=None,
            step_size=1,
        )
        print("Mesh created")
except Exception as exc:
    print("Mesh extraction failed:", repr(exc))
# ---------- end dds_mesh ----------
